# Grasshopper definition Toolpaths.gh (Grasshopper 1.0.7)
# plug-ins: Pufferfish, ClipperComponents, Shortest Walk in Gh, Kangaroo Components, Kangaroo2 Components, EleFront, Anemone, Human

# Toolpath Generation
# - Fragment is created for prototyping purposes
# - For final production a strategy should be developed considering composition, assembly, connection etc.
pipeline = GeometryPipeline(
    GroupByLayer=False,
    GroupByType=False,
    IncludeHidden=True,
    IncludeLocked=True,
    LayerFilter="Fragment::Voronoi Structure::Cells",
    NameFilter="*",
    SublayerFiltering=True,
    TypeFilter=32)  # disabled
pipeline_2 = GeometryPipeline(
    GroupByLayer=False,
    GroupByType=False,
    IncludeHidden=True,
    IncludeLocked=True,
    LayerFilter="Fragment::Print Volume",
    NameFilter="*",
    SublayerFiltering=True,
    TypeFilter=32)
offmsh = OffsetMesh(Mesh=pipeline_2, Distance=1, BothSides=False, CreateSolid=False)
pipeline_3 = GeometryPipeline(
    GroupByLayer=False,
    GroupByType=False,
    IncludeHidden=True,
    IncludeLocked=True,
    LayerFilter="Fragment::Voronoi Structure::Cells*",
    NameFilter="*",
    SublayerFiltering=True,
    TypeFilter=32)
layer_height = Slider(10, range=0..140)

# ----
# Print Bed and Direction
demesh = DeconstructMesh(Mesh=pipeline_2)  # -> Vertices, Faces, Colours, Normals
pdecon = Deconstruct(Point=demesh.Vertices)  # -> XComponent, YComponent, ZComponent
avr = Average(Input=demesh.Vertices)
sort = SortList(Keys=pdecon.ZComponent, ValuesA=demesh.Vertices)  # -> Keys, ValuesA
item = ListItem(List=sort.ValuesA, Index=0, Wrap=True)
xy = XYPlane(Origin=item)
project = Project(Geometry=avr, Plane=xy)  # -> Geometry, Transform
Z = UnitZ(Factor=expr("-x/2", layer_height))
xy_2 = XYPlane(Origin=project.Geometry)
move = Move(Geometry=xy_2, Motion=Z)  # -> Geometry, Transform
deplane = DeconstructPlane(Plane=move.Geometry)  # -> Origin, XAxis, YAxis, ZAxis

layer_width = Slider(4, range=0..40)

# ----
# Contours
contour = Contour(Shape=pipeline_3, Point=move.Geometry, Direction=deplane.ZAxis, Distance=layer_height)  # -> simplify(Contours)
join = JoinCurves(Curves=flatten(contour), Preserve=False)

# ----
# Order in Paths
pcen = PolygonCenter(Polyline=join)  # -> CenterV, CenterE, CenterA
pdecon_2 = Deconstruct(Point=pcen.CenterV)  # -> XComponent, YComponent, ZComponent
sort_2 = SortList(Keys=pdecon_2.ZComponent, ValuesA=join)  # -> Keys, ValuesA
round = Round(Number=sort_2.Keys)  # -> Nearest, Floor, Ceiling
reldif = RelativeDifferences(Values=round.Nearest)
equals = Equality(FirstNumber=reldif, SecondNumber=0)  # -> Equality, Inequality
mindex = MemberIndex(Set=equals.Inequality, Member=True)  # -> Index, Count
ins = InsertItems(List=mindex.Index, Item=0, Indices=0, Wrap=True)
lng = ListLength(List=join)
ins_2 = InsertItems(List=ins, Item=lng, Indices=-1, Wrap=True)
reldif_2 = RelativeDifferences(Values=ins_2)
cull_i = CullIndex(List=reldif_2, Indices=0, Wrap=True)
partition = PartitionList(List=sort_2.ValuesA, Size=cull_i)  # -> simplify(Chunks)
lng_2 = ListLength(List=cull_i)

branch = TreeBranch(Tree=partition, Path=Slider(6, range=0..10), MaintainPaths=True)
loop_start = LoopStart(N=Slider(50, range=0..100), T=Button(), D0=partition)  # -> port, Counter, Data, Data_2
item_2 = ListItem(List=branch, Index=Slider(295, range=200..300), Wrap=True)
item_3 = ListItem(List=branch, Index=Slider(280, range=200..300), Wrap=True)
panel = Panel(loop_start.Counter)
explode = Explode(Curve=item_2, Recursive=True)  # -> Segments, Vertices
branch_2 = TreeBranch(Tree=simplify(loop_start.Data), Path=loop_start.Counter, MaintainPaths=True)
crv = Curve(branch_2)

# ---- group: Offset
polyoffset = PolylineOffset(
    Polylines=crv,
    Distance=layer_width,
    Plane=Plane(origin=(0, 0, 0), x=(0, 0, 0), y=(0, 0, 0)),
    Tolerance=0.0001,
    ClosedFillet=1,
    OpenFillet=1,
    Miter=2)  # -> Contour, Holes
crv_2 = Curve([polyoffset.Contour, polyoffset.Holes])

# ---- group: Minimum Length and Proportions
explode_2 = Explode(Curve=crv_2, Recursive=True)  # -> Segments, Vertices
item_4 = ListItem(List=explode_2.Vertices, Index=0, Wrap=True)
fline = FitLine(Points=explode_2.Vertices)
lnpt = LinePt(Line=fline, Point=item_4)
# Offset Contours
brec = BoundingRectangle(Geometry=graft(crv_2), Plane=lnpt, Axis=0, Slide=0, Union=True)
multiplication = Multiplication(A=layer_width, B=Slider(2, range=0..10))
drec = DeconstuctRectangle(Rectangle=brec)  # -> BasePlane, XInterval, YInterval
dedomain = DeconstructDomain(Domain=drec.XInterval)  # -> Start, End
dedomain_2 = DeconstructDomain(Domain=drec.YInterval)  # -> Start, End
subtraction = Subtraction(A=dedomain.Start, B=dedomain.End)
subtraction_2 = Subtraction(A=dedomain_2.Start, B=dedomain_2.End)
abs = Absolute(Value=subtraction)
abs_2 = Absolute(Value=subtraction_2)
larger = LargerThan(FirstNumber=abs_2, SecondNumber=multiplication)  # -> LargerThan, OrEqualTo
larger_2 = LargerThan(FirstNumber=abs, SecondNumber=multiplication)  # -> LargerThan, OrEqualTo
and = GateAnd(A=larger_2.LargerThan, B=larger.LargerThan)  # -> flatten(Result)
cull = CullPattern(List=crv_2, CullPattern=and)

# ----
previewlw = CustomPreviewLineweights(Geometry=crv, Shader=ColourSwatch(SwatchColor=RGB(76, 76, 76)), Absolute=False)

# ---- group: Plane Surfaces
series = Series(Start=0, Step=layer_height, Count=1)
amp = Amplitude(Vector=deplane.ZAxis, Amplitude=series)
move_2 = Move(Geometry=move.Geometry, Motion=amp)  # -> Geometry, Transform
brec_2 = BoundingRectangle(Geometry=crv, Plane=move_2.Geometry, Axis=0, Slide=0, Union=True)
area = Area(Geometry=brec_2)  # -> Area, Centroid
# Closed Non-Overlapping Polylines
scale = Scale(Geometry=brec_2, Center=area.Centroid, Factor=1.2)  # -> Geometry, Transform
boundary = BoundarySurfaces(Edges=scale.Geometry)

# ---- group: Polylines
srfsplit = SurfaceSplit(Surface=boundary, Curves=cull)
debrep = DeconstructBrep(Brep=srfsplit)  # -> Faces, Edges, Vertices
lng_3 = ListLength(List=debrep.Vertices)
sort_3 = SortList(Keys=flatten(lng_3), ValuesA=srfsplit)  # -> Keys, ValuesA
item_5 = ListItem(List=sort_3.ValuesA, Index=-1, Wrap=True)
edges = BrepEdges(Brep=item_5)  # -> Naked, Interior, NonManifold

# ----
crv_3 = Curve(crv)
crv_4 = Curve(crv_3)
join_2 = JoinCurves(Curves=edges.Naked, Preserve=False)
cls = Closed(Curve=crv_4)  # -> Closed, Periodic
dispatch = Dispatch(List=crv_4, DispatchPattern=cls.Closed)  # -> ListA, ListB
crv_5 = Curve(join_2)
number_slider = Slider(166, range=100..200)  # disabled
number_slider_2 = Slider(453, range=200..473)  # disabled
number_slider_3 = Slider(64, range=0..461)  # disabled
number_slider_4 = Slider(388, range=200..451)  # disabled
number_slider_5 = Slider(455, range=200..473)  # disabled
xy_3 = XYPlane(Origin=Point(0, 0, 0))
num = Number(layer_width)
number_slider_6 = Slider(5, range=0..10)
X = UnitX(Factor=1)
addition = Addition(A=num, B=Slider(1, range=0..10))
addition_2 = Addition(A=num, B=number_slider_6)
dom = ConstructDomain(DomainStart=expr("-x", addition), DomainEnd=addition)
dom_2 = ConstructDomain(DomainStart=expr("-x", addition_2), DomainEnd=addition_2)
number_slider_7 = Slider(0, range=0..0.01)  # disabled
number_slider_8 = Slider(1, range=0.999..1)  # disabled

# ---- group: Split and Select
demesh_2 = DeconstructMesh(Mesh=pipeline)  # -> Vertices, Faces, Colours, Normals; disabled
minc = MeshInclusion(Mesh=pipeline_2, Point=demesh_2.Vertices, Strict=False)  # disabled
ma = MassAddition(Input=minc)  # -> Result, PartialResults; disabled
lng_4 = ListLength(List=minc)  # disabled
equals_2 = Equality(FirstNumber=ma.Result, SecondNumber=0)  # -> Equality, Inequality; disabled
equals_3 = Equality(FirstNumber=ma.Result, SecondNumber=lng_4)  # -> Equality, Inequality; disabled
and_2 = GateAnd(A=equals_2.Inequality, B=equals_3.Inequality)  # disabled
cull_2 = CullPattern(List=graft(pipeline), CullPattern=and_2)  # disabled
msplit = MeshSplit(Mesh=cull_2, Splitters=pipeline_2)  # disabled
demesh_3 = DeconstructMesh(Mesh=msplit)  # -> Vertices, Faces, Colours, Normals; disabled
minc_2 = MeshInclusion(Mesh=offmsh, Point=demesh_3.Vertices, Strict=False)  # disabled
ma_2 = MassAddition(Input=minc_2)  # -> Result, PartialResults; disabled
lng_5 = ListLength(List=minc_2)  # disabled
cull_3 = CullPattern(List=graft(pipeline), CullPattern=equals_3.Equality)  # disabled

# ----
equals_4 = Equality(FirstNumber=ma_2.Result, SecondNumber=lng_5)  # -> Equality, Inequality; disabled

# ---- group: Split and Select (continued)
cull_4 = CullPattern(List=graft(msplit), CullPattern=equals_4.Equality)  # disabled

# ---- group: Shortest Path
len = Length(Curve=crv_5)
sort_4 = SortList(Keys=len, ValuesA=crv_5)  # -> Keys, reverse(ValuesA)
cull_i_2 = CullIndex(List=sort_4.ValuesA, Indices=0, Wrap=True)
item_6 = ListItem(List=sort_4.ValuesA, Index=0, Wrap=True)
area_2 = Area(Geometry=cull_i_2)  # -> Area, Centroid
crv_cp = CurveClosestPoint(Point=area_2.Centroid, Curve=item_6)  # -> Point, Parameter, Distance
ln = Line(StartPoint=area_2.Centroid, EndPoint=crv_cp.Point)

# ---- group: Delaunay
con = DelaunayEdges(Points=area_2.Centroid, Plane=PlaneXY(0, 0, 0))  # -> Connectivity, flatten(Edges)
dupln = RemoveDuplicateLines(Lines=con.Edges, Tolerance=0.01)
trim = TrimWithRegions(Curve=dupln, Regions=dispatch.ListA)  # -> Inside, Outside
lng_6 = ListLength(List=trim.Inside)
lng_7 = ListLength(List=trim.Outside)
smaller = SmallerThan(FirstNumber=lng_7, SecondNumber=1)  # -> SmallerThan, OrEqualTo
smaller_2 = SmallerThan(FirstNumber=lng_6, SecondNumber=3)  # -> SmallerThan, OrEqualTo
and_3 = GateAnd(A=smaller_2.SmallerThan, B=smaller.SmallerThan)
cull_5 = CullPattern(List=dupln, CullPattern=flatten(and_3))  # -> flatten(List)

# ---- group: Shortest Path (continued)
shortwalk = ShortestWalk(Curves=cull_5, WantedPath=graft(ln))  # -> ShortestWalk, Succession, Direction, Length

# ---- group: Connection to Exterior from paths
explode_3 = Explode(Curve=shortwalk.ShortestWalk, Recursive=True)  # -> Segments, Vertices
Z_2 = UnitZ(Factor=1)
dupln_2 = RemoveDuplicateLines(Lines=flatten(explode_3.Segments), Tolerance=0.01)
extr = Extrude(Base=explode_3.Segments, Direction=Z_2)
smesh = SimpleMesh(Brep=extr)  # -> flatten(Mesh)
mjoin = MeshJoin(Meshes=smesh)
disjoint = DisjointMesh(Mesh=mjoin)  # -> graft(Meshes)
demesh_4 = DeconstructMesh(Mesh=disjoint)  # -> Vertices, Faces, Colours, Normals
crv_cp_2 = CurveClosestPoint(Point=demesh_4.Vertices, Curve=item_6)  # -> Point, Parameter, Distance
# Connection Diagram
sort_5 = SortList(Keys=crv_cp_2.Distance, ValuesA=crv_cp_2.Point, ValuesB=demesh_4.Vertices)  # -> Keys, ValuesA, ValuesB
item_7 = ListItem(List=sort_5.ValuesA, Index=0, Wrap=True)
item_8 = ListItem(List=sort_5.ValuesB, Index=0, Wrap=True)
ln_2 = Line(StartPoint=item_8, EndPoint=item_7)  # -> flatten(Line)

# ---- group: Connection to Exterior from single cells
pull = PullPoint(Point=area_2.Centroid, Geometry=dupln_2, ClosestOnly=True)  # -> ClosestPoint, Distance
larger_3 = LargerThan(FirstNumber=pull.Distance, SecondNumber=1)  # -> LargerThan, OrEqualTo
cull_6 = CullPattern(List=ln, CullPattern=flatten(larger_3.LargerThan))

# ---- group: Initial Connection Diagram
merge = Merge(Data1=ln_2, Data2=cull_6)
dupln_3 = RemoveDuplicateLines(Lines=flatten(merge), Tolerance=0.01)
ext = ExtendCurve(Curve=dupln_3, Type=0, Start=0, End=5)
redpline = Reduce(Polyline=ext, Tolerance=1)  # -> Polyline, Reduction
merge_2 = Merge(Data1=dupln_2, Data3=redpline.Polyline)  # -> flatten(Result)

# ---- group: Avoid Closed Loops
boundary_2 = BoundarySurfaces(Edges=item_6)
srfsplit_2 = SurfaceSplit(Surface=boundary_2, Curves=merge_2)
area_3 = Area(Geometry=srfsplit_2)  # -> Area, Centroid
lng_8 = ListLength(List=srfsplit_2)  # -> expr("x-1", Length)
sort_6 = SortList(Keys=area_3.Area, ValuesA=area_3.Centroid)  # -> Keys, ValuesA
split = SplitList(List=sort_6.ValuesA, Index=lng_8)  # -> graft(ListA), ListB
lng_9 = ListLength(List=merge_2)
crv_cp_3 = CurveClosestPoint(Point=split.ListA, Curve=merge_2)  # -> Point, Parameter, Distance
series_2 = Series(Start=0, Step=1, Count=lng_9)
sort_7 = SortList(Keys=crv_cp_3.Distance, ValuesA=series_2)  # -> Keys, ValuesA
item_9 = ListItem(List=sort_7.ValuesA, Index=0, Wrap=True)  # -> flatten(Item)
cset = CreateSet(List=item_9)  # -> Set, Map
cull_i_3 = CullIndex(List=merge_2, Indices=cset.Set, Wrap=True)

# ---- group: Refer to closed Voronoi Cells
explode_4 = Explode(Curve=cull_i_3, Recursive=True)  # -> Segments, Vertices
incurves = PointInCurves(Point=explode_4.Vertices, Curves=dispatch.ListA)  # -> Relationship, graft(Index), Point
item_10 = ListItem(List=dispatch.ListA, Index=incurves.Index, Wrap=True)
number_slider_9 = Slider(1, range=0..30)
lng_10 = ListLength(List=explode_4.Vertices)
dup = DuplicateData(Data=explode_4.Segments, Number=lng_10, Order=True)  # -> graft(Data)

# ---- group: Refer to open Voronoi Cells
graft = GraftParallel(PrimaryData=explode_4.Vertices, SecondaryData1=explode_4.Segments)  # -> PrimaryData, flatten(SecondaryData1)
trim_2 = TrimWithRegions(Curve=graft.SecondaryData1, Regions=dispatch.ListA)  # -> Inside, Outside
crv_6 = Curve(dispatch.ListB)
merge_3 = Merge(Data1=trim_2.Inside, Data2=trim_2.Outside)
explode_5 = Explode(Curve=crv_6, Recursive=True)  # -> flatten(Segments), Vertices
lng_11 = ListLength(List=merge_3)
smaller_3 = SmallerThan(FirstNumber=lng_11, SecondNumber=3)  # -> flatten(SmallerThan), OrEqualTo
equals_5 = Equality(FirstNumber=incurves.Index, SecondNumber=-1)  # -> flatten(Equality), Inequality
and_4 = GateAnd(A=equals_5.Equality, B=smaller_3.SmallerThan)
ext_2 = ExtendCurve(Curve=explode_5.Segments, Type=0, Start=number_slider_9, End=number_slider_9)  # -> simplify(Curve)
cull_7 = CullPattern(List=graft.SecondaryData1, CullPattern=and_4)  # -> flatten(List)
Z_3 = UnitZ(Factor=1)
extr_2 = Extrude(Base=ext_2, Direction=Z_3)
extr_3 = Extrude(Base=cull_7, Direction=Z_3)
smesh_2 = SimpleMesh(Brep=extr_2)
smesh_3 = SimpleMesh(Brep=extr_3)
clash = Clash(FirstSet=smesh_2, SecondSet=smesh_3, Distance=0, L=100)  # -> ClashCount, ClashPoints, ClashRadii, FirstIndex, SecondIndex

# ----
# Select Connecting Edges
boundary_3 = BoundarySurfaces(Edges=item_10)
edges_2 = BrepEdges(Brep=boundary_3)  # -> Naked, Interior, NonManifold
join_3 = JoinCurves(Curves=edges_2.Naked, Preserve=False)

# ---- group: Refer to closed Voronoi Cells (continued)
explode_6 = Explode(Curve=join_3, Recursive=True)  # -> Segments, Vertices
ext_3 = ExtendCurve(Curve=explode_6.Segments, Type=0, Start=number_slider_9, End=number_slider_9)  # -> simplify(Curve)
lng_12 = ListLength(List=ext_3)
dup_2 = DuplicateData(Data=dup, Number=lng_12, Order=True)  # -> graft(Data)

# ---- group: Refer to open Voronoi Cells (continued)
cluster = Cluster(L=ext_2, i=clash.FirstIndex, I=clash.SecondIndex, T=ext_3)
cluster_2 = Cluster(L=explode_5.Segments, i=clash.FirstIndex, I=clash.SecondIndex, T=ext_3)
cluster_3 = Cluster(L=cull_7, i=clash.SecondIndex, I=clash.SecondIndex, T=ext_3)
path_mapper = PathMapper(cluster_3, source="{A}(i)", target="{A;0;i}")
path_mapper_2 = PathMapper(cluster, source="{A}(i)", target="{A;0;i}")
path_mapper_3 = PathMapper(cluster_2, source="{A}(i)", target="{A;0;i}")

# ---- group: Extended Voronoi Cells
merge_4 = Merge(Data1=simplify(graft(ext_3)), Data2=path_mapper_2)

# ---- group: Voronoi Cells
merge_5 = Merge(Data1=simplify(graft(explode_6.Segments)), Data2=path_mapper_3)

# ---- group: Diagram
merge_6 = Merge(Data1=simplify(dup_2), Data2=path_mapper)

# ----
ccx = CurveCurve(CurveA=merge_6, CurveB=merge_4)  # -> Points, ParamsA, ParamsB

# ---- group: Select most orthogonal Edges
eval = EvaluateCurve(Curve=graft(merge_4), Parameter=ccx.ParamsB)  # -> Point, simplify(Tangent), Angle
eval_2 = EvaluateCurve(Curve=merge_6, Parameter=ccx.ParamsA)  # -> Point, Tangent, Angle
trim_3 = TrimTree(Tree=simplify(eval_2.Tangent), Depth=1)
trim_4 = TrimTree(Tree=simplify(eval.Tangent), Depth=1)
vrot = Rotate(Vector=trim_4, Axis=Z_2, Angle=1.570796327)
neg = Negative(Value=vrot)
angle = Angle(VectorA=trim_3, VectorB=vrot)  # -> Angle, Reflex
angle_2 = Angle(VectorA=trim_3, VectorB=neg)  # -> Angle, Reflex
max = Maximum(A=angle.Angle, B=angle_2.Angle)
lng_13 = ListLength(List=max)
series_3 = Series(Start=0, Step=1, Count=lng_13)
sort_8 = SortList(Keys=max, ValuesA=series_3)  # -> Keys, reverse(ValuesA)
item_11 = ListItem(List=sort_8.Keys, Index=0, Wrap=True)
similar = Similarity(FirstNumber=sort_8.Keys, SecondNumber=item_11, Threshold=0.1)  # -> Similarity, AbsoluteDifference
cull_8 = CullPattern(List=sort_8.ValuesA, CullPattern=similar.Similarity)

# ---- group: Select intersected Voronoi Edges
lng_14 = ListLength(List=eval.Point)
equals_6 = Equality(FirstNumber=lng_14, SecondNumber=1)  # -> Equality, Inequality
cull_9 = CullPattern(List=merge_5, CullPattern=equals_6.Equality)
trim_5 = TrimTree(Tree=simplify(cull_9), Depth=1)

# ----
tstat = TreeStatistics(Tree=simplify(trim_5))  # -> Paths, Length, Count; disabled
item_12 = ListItem(List=tstat.Paths, Index=number_slider, Wrap=True)  # disabled
split_2 = SplitList(List=tstat.Paths, Index=number_slider)  # -> ListA, ListB; disabled
branch_3 = TreeBranch(Tree=simplify(similar.Similarity), Path=item_12, MaintainPaths=True)  # disabled
branch_4 = TreeBranch(Tree=simplify(sort_8.Keys), Path=item_12, MaintainPaths=True)  # disabled
branch_5 = TreeBranch(Tree=simplify(trim_5), Path=item_12, MaintainPaths=True)  # disabled
panel_2 = Panel(branch_4)  # disabled
panel_3 = Panel(branch_3)  # disabled
clean = CleanTree(RemoveNulls=True, RemoveInvalid=True, RemoveEmpty=False, Tree=item_11)  # disabled
item_13 = ListItem(List=trim_5, Index=item_11, Wrap=True)  # disabled

# ---- group: Select most orthogonal Edges (continued)
item_14 = ListItem(List=trim_5, Index=cull_8, Wrap=True)

# ---- group: Select Longest Edge
len_2 = Length(Curve=item_14)
sort_9 = SortList(Keys=len_2, ValuesA=item_14)  # -> Keys, reverse(ValuesA)
equals_7 = Equality(FirstNumber=lng_13, SecondNumber=0)  # -> Equality, Inequality
item_15 = ListItem(List=sort_9.ValuesA, Index=0, Wrap=True)
cull_10 = CullPattern(List=item_15, CullPattern=equals_7.Inequality)

# ----
tstat_2 = TreeStatistics(Tree=simplify(cull_10))  # -> Paths, Length, Count; disabled
item_16 = ListItem(List=tstat_2.Paths, Index=number_slider_4, Wrap=True)  # disabled
item_17 = ListItem(List=tstat_2.Paths, Index=number_slider_2, Wrap=True)  # disabled
split_3 = SplitList(List=tstat_2.Paths, Index=number_slider_5)  # -> ListA, ListB; disabled
branch_6 = TreeBranch(Tree=simplify(sort_9.ValuesA), Path=item_16, MaintainPaths=True)  # disabled
branch_7 = TreeBranch(Tree=simplify(sort_9.ValuesA), Path=item_17, MaintainPaths=True)  # disabled
explode_7 = Explode(Curve=branch_6, Recursive=True)  # -> Segments, Vertices; disabled
branch_8 = TreeBranch(Tree=simplify(sort_9.ValuesA), Path=split_3.ListA, MaintainPaths=True)  # disabled

dupln_4 = RemoveDuplicateLines(Lines=flatten(cull_10), Tolerance=0.1)

# ---- group: Trim Regions
eval_3 = EvaluateCurve(Curve=reparameterize(dupln_4), Parameter=0.5)  # -> Point, Tangent, Angle
Z_4 = UnitZ(Factor=1)
pl = PlaneNormal(Origin=eval_3.Point, ZAxis=Z_4)
deplane_2 = DeconstructPlane(Plane=pl)  # -> Origin, XAxis, YAxis, ZAxis
angle_3 = Angle(VectorA=deplane_2.XAxis, VectorB=eval_3.Tangent, Plane=pl)  # -> Angle, Reflex
prot = RotatePlane(Plane=pl, Angle=angle_3.Angle)
dom_3 = ConstructDomain(DomainStart=expr("-x*3", layer_width), DomainEnd=expr("x*3", layer_width))
dom_4 = ConstructDomain(DomainStart=expr("-x", layer_width), DomainEnd=layer_width)
rectangle = Rectangle(Plane=prot, XSize=dom_4, YSize=dom_3, Radius=layer_width)  # -> flatten(Rectangle), Length
runion = RegionUnion(Curves=rectangle.Rectangle)

# ---- group: Trim
# Continuous Toolpath
trim_6 = TrimWithRegions(Curve=crv_5, Regions=runion)  # -> Inside, Outside
trim_7 = TrimWithRegions(Curve=runion, Regions=cull_i_2)  # -> Inside, Outside
trim_8 = TrimWithRegions(Curve=trim_7.Outside, Regions=item_6)  # -> Inside, Outside
trim_9 = TrimTree(Tree=simplify(trim_8.Inside), Depth=1)
end = EndPoints(Curve=trim_9)  # -> Start, End
ln_3 = Line(StartPoint=end.Start, EndPoint=end.End)
merge_7 = Merge(Data1=simplify(trim_6.Outside), Data2=simplify(ln_3))
join_4 = JoinCurves(Curves=flatten(merge_7), Preserve=False)

# ---- group: Assign Data Tree Path
tstat_3 = TreeStatistics(Tree=join_4)  # -> Paths, Length, Count
path = ConstructPath(Indices=loop_start.Counter)
replace = ReplacePaths(Data=join_4, Search=tstat_3.Paths, Replace=path)

# ----
merge_8 = Merge(Data1=loop_start.Data_2, Data2=replace)
clean_2 = CleanTree(RemoveNulls=True, RemoveInvalid=True, RemoveEmpty=False, Tree=merge_8)
loop_end = LoopEnd(
    port=loop_start.port,
    Exit=False,
    Data=simplify(loop_start.Data),
    Data_2=clean_2,
    TimeOutVal=0,
    pausedState=False,
    state="Output last")  # -> D0, D1
clean_3 = CleanTree(RemoveNulls=True, RemoveInvalid=True, RemoveEmpty=True, Tree=loop_end.D1)

# ---- group: Close and Cull too Short
num_2 = Number(layer_width)
clscrv = CloseCurve(Curve=clean_3, CloseType=0, Bulge=0.5, Tolerance=expr("x*6", num_2))  # -> Closed, R
len_3 = Length(Curve=clscrv.Closed)
smaller_4 = SmallerThan(FirstNumber=len_3, SecondNumber=expr("x*12", num_2))  # -> SmallerThan, OrEqualTo
cull_11 = CullPattern(List=clscrv.Closed, CullPattern=invert(smaller_4.SmallerThan))

# ----
len_4 = Length(Curve=join_4)  # disabled
sort_10 = SortList(Keys=len_4, ValuesA=join_4)  # -> Keys, reverse(ValuesA); disabled
cull_i_4 = CullIndex(List=sort_10.ValuesA, Indices=0, Wrap=True)  # disabled
branch_9 = TreeBranch(Tree=cull_11, Path=Slider(15, range=0..15), MaintainPaths=True)
item_18 = ListItem(List=branch_9, Index=Slider(3, range=0..20), Wrap=True)
viewer = ParamViewer(clean_3)
crv_7 = Curve(cull_11)
loop_start_2 = LoopStart(N=Slider(22, range=0..100), T=Button(), D0=simplify(crv_7))  # -> port, Counter, Data, Data_2
panel_4 = Panel(loop_start_2.Counter)
tstat_4 = TreeStatistics(Tree=loop_start_2.Data)  # -> Paths, Length, Count
item_19 = ListItem(List=tstat_4.Paths, Index=loop_start_2.Counter, Wrap=False)
branch_10 = TreeBranch(Tree=simplify(loop_start_2.Data), Path=item_19, MaintainPaths=True)
lng_15 = ListLength(List=branch_10)
larger_4 = LargerThan(FirstNumber=lng_15, SecondNumber=1)  # -> LargerThan, OrEqualTo
gate = StreamGate(Stream=branch_10, Gate=larger_4.LargerThan)  # -> Target0, Target1
item_20 = ListItem(List=gate.Target1, Index=Slider(0, range=0..10), Wrap=True)
len_5 = Length(Curve=gate.Target1)
sort_11 = SortList(Keys=len_5, ValuesA=gate.Target1)  # -> Keys, reverse(ValuesA)
split_4 = SplitList(List=sort_11.ValuesA, Index=1)  # -> ListA, ListB
crvprox = CurveProximity(CurveA=split_4.ListA, CurveB=split_4.ListB)  # -> PointA, PointB, Distance
explode_8 = Explode(Curve=split_4.ListB, Recursive=True)  # -> Segments, Vertices; disabled
explode_9 = Explode(Curve=split_4.ListA, Recursive=True)  # -> Segments, Vertices; disabled
ln_4 = Line(StartPoint=crvprox.PointA, EndPoint=crvprox.PointB)
crvnear = CurveNearestObject(Curve=split_4.ListA, Geometry=explode_8.Segments)  # -> PointA, PointB, Index; disabled
crvnear_2 = CurveNearestObject(Curve=split_4.ListB, Geometry=explode_9.Segments)  # -> PointA, PointB, Index; disabled
cull_i_5 = CullIndex(List=explode_8.Segments, Indices=crvnear.Index, Wrap=True)  # disabled
eval_4 = EvaluateCurve(Curve=reparameterize(ln_4), Parameter=0.5)  # -> Point, Tangent, Angle
cull_i_6 = CullIndex(List=explode_9.Segments, Indices=crvnear_2.Index, Wrap=True)  # disabled
vrot_2 = Rotate(Vector=eval_4.Tangent, Axis=Z_2, Angle=1.570796327)
amp_2 = Amplitude(Vector=vrot_2, Amplitude=num)
devec = DeconstructVector(Vector=amp_2)  # -> XComponent, YComponent, ZComponent
vec = VectorXYZ(XComponent=devec.XComponent, YComponent=devec.YComponent, ZComponent=0)  # -> Vector, Length
curvepoint = PointOnCurve(ln_4, parameter=0.5)
angle_4 = Angle(VectorA=X, VectorB=vec.Vector, Plane=xy_3)  # -> Angle, Reflex
prot_2 = RotatePlane(Plane=xy_3, Angle=angle_4.Angle)
pl_origin = PlaneOrigin(Base=prot_2, Origin=curvepoint)
crv_8 = Curve(gate.Target1)
rectangle_2 = Rectangle(Plane=pl_origin, XSize=dom, YSize=dom_2, Radius=number_slider_6)  # -> Rectangle, Length
runion_2 = RegionUnion(Curves=rectangle_2.Rectangle, Plane=xy_3)
crv_9 = Curve(runion_2)
trim_10 = TrimWithRegions(Curve=gate.Target1, Regions=crv_9, Plane=xy_3)  # -> Inside, Outside
group = Group(Objects=trim_10.Outside)  # disabled
trim_11 = TrimTree(Tree=group, Depth=1)  # disabled
item_21 = ListItem(List=crv_8, Index=Slider(3, range=0..10), Wrap=True)
lng_16 = ListLength(List=trim_11)  # disabled
series_4 = Series(Start=0, Step=1, Count=lng_16)  # disabled
end_2 = EndPoints(Curve=trim_10.Outside)  # -> Start, End
trim_12 = TrimTree(Tree=trim_10.Outside, Depth=1)
cull_i_7 = CullIndex(List=trim_11, Indices=graft(series_4), Wrap=True)  # disabled
merge_9 = Merge(Data1=end_2.Start, Data2=end_2.End)  # -> flatten(Result)
lng_17 = ListLength(List=runion_2)
ungroup = Ungroup(Group=cull_i_7)  # disabled
crv_cp_4 = CurveClosestPoint(Point=graft(merge_9), Curve=runion_2)  # -> Point, Parameter, Distance
series_5 = Series(Start=0, Step=1, Count=lng_17)
trim_13 = TrimTree(Tree=ungroup, Depth=1)  # disabled
sort_12 = SortList(Keys=crv_cp_4.Distance, ValuesA=series_5)  # -> Keys, ValuesA
end_3 = EndPoints(Curve=simplify(trim_10.Outside))  # -> Start, End; disabled
end_4 = EndPoints(Curve=trim_13)  # -> Start, End; disabled
item_22 = ListItem(List=sort_12.ValuesA, Index=0, Wrap=True)
tstat_5 = TreeStatistics(Tree=graft(merge_9))  # -> Paths, Length, Count
merge_10 = Merge(Data1=simplify(end_4.Start), Data2=simplify(end_4.End))  # disabled
path_2 = ConstructPath(Indices=item_22)  # -> flatten(Branch)
replace_2 = ReplacePaths(Data=graft(merge_9), Search=tstat_5.Paths, Replace=path_2)
cp = ClosestPoint(Point=end_3.Start, Cloud=merge_10)  # -> ClosestPoint, CPIndex, Distance; disabled
cp_2 = ClosestPoint(Point=end_3.End, Cloud=merge_10)  # -> ClosestPoint, CPIndex, Distance; disabled
crv_10 = Curve(trim_10.Inside)
alongcrv = SortAlongCurve(Points=replace_2, Curve=graft(runion_2))  # -> Points, Indices
trim_14 = TrimTree(Tree=crv_10, Depth=1)
ln_5 = Line(StartPoint=end_3.Start, EndPoint=cp.ClosestPoint)  # disabled
ln_6 = Line(StartPoint=end_3.End, EndPoint=cp_2.ClosestPoint)  # disabled
end_5 = EndPoints(Curve=trim_14)  # -> Start, End
merge_11 = Merge(Data1=ln_5, Data2=ln_6)  # disabled
pline = PolyLine(Vertices=alongcrv.Points, Closed=True)
ln_7 = Line(StartPoint=end_5.Start, EndPoint=end_5.End)
explode_10 = Explode(Curve=pline, Recursive=True)  # -> Segments, Vertices
curvepoint_2 = PointOnCurve(ln_7, parameter=0.5)
curvepoint_3 = PointOnCurve(explode_10.Segments, parameter=0.5)
cp_3 = ClosestPoint(Point=curvepoint_2, Cloud=curvepoint_3)  # -> ClosestPoint, CPIndex, Distance
cull_i_8 = CullIndex(List=explode_10.Segments, Indices=cp_3.CPIndex, Wrap=True)
dupln_5 = RemoveDuplicateLines(Lines=flatten(cull_i_8), Tolerance=0.01)
len_6 = Length(Curve=dupln_5)
smaller_5 = SmallerThan(FirstNumber=len_6, SecondNumber=expr("x*6", num))  # -> SmallerThan, OrEqualTo
cull_12 = CullPattern(List=dupln_5, CullPattern=smaller_5.SmallerThan)
merge_12 = Merge(Data1=trim_12, Data2=cull_12)
join_5 = JoinCurves(Curves=flatten(merge_12), Preserve=False)
tstat_6 = TreeStatistics(Tree=join_5)  # -> Paths, Length, Count
item_23 = ListItem(List=join_5, Index=Slider(1, range=0..10), Wrap=True)
replace_3 = ReplacePaths(Data=join_5, Search=tstat_6.Paths, Replace=item_19)
filter = StreamFilter(Gate=larger_4.LargerThan, Stream0=gate.Target0, Stream1=replace_3)
eval_5 = EvaluateCurve(Curve=reparameterize(join_5), Parameter=number_slider_7)  # -> Point, Tangent, Angle; disabled
merge_13 = Merge(Data1=loop_start_2.Data_2, Data2=filter)
loop_end_2 = LoopEnd(
    port=loop_start_2.port,
    Exit=False,
    Data=simplify(loop_start_2.Data),
    Data_2=merge_13,
    TimeOutVal=0,
    pausedState=False,
    state="Output last")  # -> D0, D1
viewer_2 = ParamViewer(loop_end_2.D1)
branch_11 = TreeBranch(Tree=simplify(loop_end_2.D1), Path=Slider(15, range=0..40), MaintainPaths=True)
panel_5 = Panel(loop_end_2.D1)
item_24 = ListItem(List=branch_11, Index=Slider(0, range=0..100), Wrap=True)

# ==== cluster Cluster
T = ClusterInput()
L = ClusterInput()
i = ClusterInput()
I = ClusterInput()
tstat = TreeStatistics(Tree=simplify(T))  # -> Paths, Length, Count
item = ListItem(List=L, Index=i, Wrap=True)  # -> graft(Item)
path = ConstructPath(Indices=graft(I))  # -> flatten(Branch)
tstat_2 = TreeStatistics(Tree=item)  # -> Paths, Length, Count
item_2 = ListItem(List=tstat.Paths, Index=-1, Wrap=True)
replace = ReplacePaths(Data=item, Search=tstat_2.Paths, Replace=path)
dpath = DeconstructPath(Branch=item_2)
tstat_3 = TreeStatistics(Tree=replace)  # -> Paths, Length, Count
item_3 = ListItem(List=dpath, Index=0, Wrap=True)
lng = ListLength(List=tstat_3.Paths)
series = Series(Start=expr("x+1", item_3), Step=1, Count=lng)
path_2 = ConstructPath(Indices=graft(series))  # -> flatten(Branch)
replace_2 = ReplacePaths(Data=replace, Search=tstat_3.Paths, Replace=path_2)
D = ClusterOutput(replace_2)
