# Grasshopper definition fibo_test.gh (Grasshopper 1.0.7)

path = FilePath("fibo.py")
python = GhPythonScript(fileName=path, number=Slider(1, range=1..150))  # -> out, a
# ---------- python: Python ----------
__author__ = "maxla"
__version__ = "2021.03.16"

import rhinoscriptsyntax as rs
import sys

# Append filePath for import if necessary:
pathAppended = False
filePath = rs.WorkingFolder() + fileName

for x in sys.path:
    if(x==filePath):
        pathAppended = True

if (pathAppended == False):
    sys.path.append(filePath)

for x in sys.path:
    print(x)


import fibo
#from fibo import fib

#fib2 = fibo.fib2
a = fibo.fib2(number)
# ---------- end python ----------
panel = Panel(python.a)
